# Grasshopper definition icebridge2.gh (Grasshopper 1.0.7)
# plug-ins: Ironbug.LBHB_Legacy, Rhino.Inside for Autodesk Revit

number_slider = Slider(0, range=0..100)
geo = Geometry([<brep referenced from the Rhino model> x14, <curve referenced from the Rhino model>, <brep referenced from the Rhino model> x12])
model = ModelCategoriesPicker({"Abutments": -2006130, "Air Systems": -2001008, "Air Terminals": -2008013, "Analysis Display Style": -2000304, "Analysis Results": -2000303, "Areas": -2003200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}, selected="Rooms": -2000160)
debrep = DeconstructBrep(Brep=geo)  # -> Faces, Edges, Vertices
panel = Panel("floorplan plus height")
vec = VectorXYZ(XComponent=number_slider, YComponent=number_slider, ZComponent=Slider(1, range=0..1))  # -> Vector, Length
edgesdir = EdgesFromDirections(Brep=debrep.Faces, Directions=vec.Vector, Reflex=True, Angle=0)  # -> Edges, Indices, Map
edges = BrepEdges(Brep=debrep.Faces)  # -> Naked, Interior, NonManifold
len = Length(Curve=edgesdir.Edges)
item = ListItem(List=len, Index=0, Wrap=True)  # -> flatten(Item)
catfltr = ElementCategoryFilter(Categories=model, Inverted=False)
catfltr_2 = ElementCategoryFilter(Categories=model, Inverted=False)
cull = CullPattern(List=edges.Naked, CullPattern=item)
end = EndPoints(Curve=cull)  # -> Start, End
elements = DocumentElements(Filter=catfltr_2)
elements_2 = DocumentElements(Filter=catfltr)
geometry = ElementGeometry(Elements=elements)
panel_2 = Panel(cull)
item_2 = ListItem(List=end.Start, Index=Slider(0, range=0..100), Wrap=True)  # -> flatten(Item)
debrep_2 = DeconstructBrep()  # -> Faces, Edges, Vertices
lng = ListLength(List=item_2)
split = SplitList(List=debrep_2.Faces, Index=Slider(1, range=0..1))  # -> ListA, ListB
geo_2 = Geometry(split.ListA)
debrep_3 = DeconstructBrep(Brep=split.ListA)  # -> Faces, Edges, Vertices

# ---- group: Settings
ida_ice_path = Panel("C:\Program Files (x86)\IDA4.8sp2\bin\ice.exe")
ida_modell_path = Panel("C:\Temp")
ida_ice_modell_name = Panel("building2.idm")
python_api_path = Panel("C:\Users\Max Tillberg\AppData\Local\\Programs\Python\\Python39\python.exe")

# ---- group: Read result, note that the paths and result are hard coded
panel_3 = Panel("""from util import *

#Connect to the IDA API instance of the process you just started in the util.py file.

test = ida_lib.connect_to_ida(b"5945", pid.encode())

#Open a saved building

building = call_ida_api_function(ida_lib.openDocument, b"C:\\Temp\\building1.idm")

# Getting name of building
name = ida_get_name(building)
#print("Opening case: " + name)
#print("Now performing simulation...")

#Retrieving data
energy_report = ida_get_named_child(building,"ENERGY-REPORT")
demand = ida_get_named_child(energy_report,"DEMAND")
fuel_heating = ida_get_named_child(demand,"Fuel heating")
fuel_heating_value = ida_get_value(fuel_heating)
print("Fuel heating, peak demand: " + str(fuel_heating_value) + " kW")
#print(fuel_heating_value)

electric_cooling = ida_get_named_child(demand,"Electric cooling")
electric_cooling_value = ida_get_value(electric_cooling)
#print(electric_cooling_value)
print("Electric cooling, peak demand: " + str(electric_cooling_value) + " kW")

#Disconnect
end = ida_lib.ida_disconnect()""")
panel_4 = Panel("""import ctypes
import json
import time
from win32 import win32process
import sys
import os

path_to_ice = "C:\\Program Files (x86)\\IDA4.8sp2\\bin\\"
path_to_api = "C:\\Program Files (x86)\\idaapi64\\"
command = path_to_ice + "ida-ice.exe \"" + path_to_ice + "ida.img\" -G 1"
startObj = win32process.STARTUPINFO()
ret = win32process.CreateProcess(None,command,None,None,0,0,None,None,startObj)
pid = str(ret[2])
#print(pid)
time.sleep(5)
#Add path_to_ice to PATH variable, is removed when program finishes
os.environ['PATH'] = path_to_ice + os.pathsep  + os.environ['PATH']
os.environ['PATH'] = path_to_api + os.pathsep + os.environ['PATH']

ida_lib = ctypes.CDLL(path_to_api + 'idaapi2.dll')

ida_lib.connect_to_ida.restype = ctypes.c_bool
ida_lib.connect_to_ida.argtypes = [ctypes.c_char_p, ctypes.c_char_p]
ida_lib.switch_remote_connection.restype = ctypes.c_bool
ida_lib.switch_remote_connection.argtypes = [ctypes.c_char_p]
ida_lib.switch_api_version.restype = ctypes.c_bool
ida_lib.switch_api_version.argtypes = [ctypes.c_long]
ida_lib.call_ida_function.restype = ctypes.c_long
ida_lib.call_ida_function.argtypes = [ctypes.c_char_p, ctypes.c_char_p, ctypes.c_char_p, ctypes.c_int]
ida_lib.ida_disconnect.restype = ctypes.c_bool
ida_lib.ida_disconnect.argtypes = []
ida_lib.get_err.restype = ctypes.c_long
ida_lib.get_err.argtypes = [ctypes.c_char_p, ctypes.c_int]
ida_lib.childNodes.restype = ctypes.c_long
ida_lib.childNodes.argtypes = [ctypes.c_long, ctypes.c_char_p, ctypes.c_int]
ida_lib.parentNode.restype = ctypes.c_long
ida_lib.parentNode.argtypes = [ctypes.c_long, ctypes.c_char_p, ctypes.c_int]
ida_lib.setParentNode.restype = ctypes.c_long
ida_lib.setParentNode.argtypes = [ctypes.c_long, ctypes.c_long, ctypes.c_char_p, ctypes.c_int]
ida_lib.hasChildNodes.restype = ctypes.c_long
ida_lib.hasChildNodes.argtypes = [ctypes.c_long, ctypes.c_char_p, ctypes.c_int]
ida_lib.firstChild.restype = ctypes.c_long
ida_lib.firstChild.argtypes = [ctypes.c_long, ctypes.c_char_p, ctypes.c_int]
ida_lib.lastChild.restype = ctypes.c_long
ida_lib.lastChild.argtypes = [ctypes.c_long, ctypes.c_char_p, ctypes.c_int]
ida_lib.nextSibling.restype = ctypes.c_long
ida_lib.nextSibling.argtypes = [ctypes.c_long, ctypes.c_char_p, ctypes.c_int]
ida_lib.previousSibling.restype = ctypes.c_long
ida_lib.previousSibling.argtypes = [ctypes.c_long, ctypes.c_char_p, ctypes.c_int]
ida_lib.childNodesLength.restype = ctypes.c_long
ida_lib.childNodesLength.argtypes = [ctypes.c_long, ctypes.c_char_p, ctypes.c_int]
ida_lib.setNodeValue.restype = ctypes.c_long
ida_lib.setNodeValue.argtypes = [ctypes.c_long, ctypes.c_char_p, ctypes.c_char_p, ctypes.c_int]
ida_lib.cloneNode.restype = ctypes.c_long
ida_lib.cloneNode.argtypes = [ctypes.c_long, ctypes.c_char_p, ctypes.c_int]
ida_lib.insertBefore.restype = ctypes.c_long
ida_lib.insertBefore.argtypes = [ctypes.c_long, ctypes.c_char_p, ctypes.c_char_p, ctypes.c_int]
ida_lib.createNode.restype = ctypes.c_long
ida_lib.createNode.argtypes = [ctypes.c_long, ctypes.c_char_p, ctypes.c_char_p, ctypes.c_int]
ida_lib.contains.restype = ctypes.c_long
ida_lib.contains.argtypes = [ctypes.c_long, ctypes.c_long, ctypes.c_char_p, ctypes.c_int]
ida_lib.domAncestor.restype = ctypes.c_long
ida_lib.domAncestor.argtypes = [ctypes.c_long, ctypes.c_long, ctypes.c_char_p, ctypes.c_int]
ida_lib.item.restype = ctypes.c_long
ida_lib.item.argtypes = [ctypes.c_long, ctypes.c_long, ctypes.c_char_p, ctypes.c_int]
ida_lib.appendChild.restype = ctypes.c_long
ida_lib.appendChild.argtypes = [ctypes.c_long, ctypes.c_long, ctypes.c_char_p, ctypes.c_int]
ida_lib.removeChild.restype = ctypes.c_long
ida_lib.removeChild.argtypes = [ctypes.c_long, ctypes.c_long, ctypes.c_char_p, ctypes.c_int]
ida_lib.replaceChild.restype = ctypes.c_long
ida_lib.replaceChild.argtypes = [ctypes.c_long, ctypes.c_long, ctypes.c_char_p, ctypes.c_int]
ida_lib.setAttribute.restype = ctypes.c_long
ida_lib.setAttribute.argtypes = [ctypes.c_char_p, ctypes.c_long, ctypes.c_char_p, ctypes.c_char_p, ctypes.c_int]
ida_lib.getAttribute.restype = ctypes.c_long
ida_lib.getAttribute.argtypes = [ctypes.c_char_p, ctypes.c_long, ctypes.c_char_p, ctypes.c_int]
ida_lib.openDocument.restype = ctypes.c_long
ida_lib.openDocument.argtypes = [ctypes.c_char_p, ctypes.c_char_p, ctypes.c_int]
ida_lib.openDocByTypeAndName.restype = ctypes.c_long
ida_lib.openDocByTypeAndName.argtypes = [ctypes.c_char_p, ctypes.c_char_p, ctypes.c_char_p, ctypes.c_int]
ida_lib.saveDocument.restype = ctypes.c_long
ida_lib.saveDocument.argtypes = [ctypes.c_long, ctypes.c_char_p, ctypes.c_long, ctypes.c_char_p, ctypes.c_int]
ida_lib.runSimulation.restype = ctypes.c_long
ida_lib.runSimulation.argtypes = [ctypes.c_long, ctypes.c_long, ctypes.c_char_p, ctypes.c_int]
ida_lib.pollForQueuedResults.restype = ctypes.c_long
ida_lib.pollForQueuedResults.argtypes = [ctypes.c_char_p, ctypes.c_int]
ida_lib.getZones.restype = ctypes.c_long
ida_lib.getZones.argtypes = [ctypes.c_long, ctypes.c_char_p, ctypes.c_int]
ida_lib.getWindows.restype = ctypes.c_long
ida_lib.getWindows.argtypes = [ctypes.c_long, ctypes.c_char_p, ctypes.c_int]
ida_lib.getChildrenOfType.restype = ctypes.c_long
ida_lib.getChildrenOfType.argtypes = [ctypes.c_long, ctypes.c_char_p, ctypes.c_char_p, ctypes.c_int]
ida_lib.findNamedChild.restype = ctypes.c_long
ida_lib.findNamedChild.argtypes = [ctypes.c_long, ctypes.c_char_p, ctypes.c_char_p, ctypes.c_int]
ida_lib.exitSession.restype = ctypes.c_long
ida_lib.exitSession.argtypes = [ctypes.c_char_p, ctypes.c_int]
ida_lib.getAllSubobjectsOfType.restype = ctypes.c_long
ida_lib.getAllSubobjectsOfType.argtypes = [ctypes.c_long, ctypes.c_char_p, ctypes.c_char_p, ctypes.c_int]
ida_lib.runIDAScript.restype = ctypes.c_long
ida_lib.runIDAScript.argtypes = [ctypes.c_long, ctypes.c_char_p, ctypes.c_char_p, ctypes.c_int]
ida_lib.copyObject.restype = ctypes.c_long
ida_lib.copyObject.argtypes = [ctypes.c_long, ctypes.c_char_p, ctypes.c_char_p, ctypes.c_int]
ida_lib.findObjectsByCriterium.restype = ctypes.c_long
ida_lib.findObjectsByCriterium.argtypes = [ctypes.c_long, ctypes.c_char_p, ctypes.c_char_p, ctypes.c_int]
ida_lib.findUseOfResource.restype = ctypes.c_long
ida_lib.findUseOfResource.argtypes = [ctypes.c_long, ctypes.c_char_p, ctypes.c_int]
ida_lib.printReport.restype = ctypes.c_long
ida_lib.printReport.argtypes = [ctypes.c_long, ctypes.c_char_p, ctypes.c_long, ctypes.c_char_p, ctypes.c_int]






#Utility functions

def ida_poll_results_queue (time_interval):
  size = 5000
  doc_str = ctypes.create_string_buffer(size) 
  poll_result = False
  while poll_result == False:
    time.sleep(time_interval)
    poll_res = ida_lib.pollForQueuedResults(doc_str, len(doc_str))
    poll_result2 = json.loads(doc_str.value.decode("utf-8"))
    if isinstance(poll_result2, list):
      poll_result = poll_result2[0]['value']
    else:
      return ""
  return poll_result2[1]['value']

def call_ida_api_function (fun, *args):
  "Just send in the function name and its unique arguments (not out buffer and out buffer length)" 
  p = ctypes.create_string_buffer(5000)    
  args = args + (p,len(p))
  res = fun(*args)
  if res == 0:
    return ida_poll_results_queue(0.1)
  else:
    p = ctypes.create_string_buffer(res) 
    res = fun(*args)
    if res == 0:
      return ida_poll_results_queue(0.1)
    else:
      return ""

def call_ida_api_function_j (fun, *args):
  "Just send in the function name and its unique arguments (not out buffer and out buffer length)" 
  p = ctypes.create_string_buffer(5000)    
  args = args + (p,len(p))
  res = fun(*args)
  if res == 0:
    return p
  else:
    p = ctypes.create_string_buffer(res) 
    res = fun(*args)
    if res == 0:
      return p
    else:
      return ""



def ida_poll_results_queue_j (time_interval):
  size = 5000
  doc_str = ctypes.create_string_buffer(size) 
  poll_result = False
  while poll_result == False:
    time.sleep(time_interval)
    poll_res = ida_lib.pollForQueuedResults(doc_str, len(doc_str))
    poll_result2 = json.loads(doc_str.value.decode("utf-8"))
    if isinstance(poll_result2, list):
      poll_result = poll_result2[0]['value']
    else:
      return ""
  return json.dumps(poll_result2[1])

def ida_get_named_child(par,name):
  site_res = call_ida_api_function(ida_lib.findNamedChild,par, name.encode())
  return site_res

def ida_get_value(par):
  val = call_ida_api_function(ida_lib.getAttribute,b"VALUE", par)
  return val

def ida_get_name(par):
  val = call_ida_api_function(ida_lib.getAttribute,b"NAME", par)
  return val""")
read_result = GhPythonScript(Python=python_api_path, Path=ida_modell_path, Util=panel_4, Code=panel_3, Run=Toggle(False))  # -> out
# ---------- read_result: Python ----------
__author__ = "Max Tillberg"
__version__ = "2021.04.04"

import rhinoscriptsyntax as rs
import subprocess


if Run:
    #Skapa pythonkoden
    fp = open("C:\\Temp\\readresult.py", "w")
    fp.write(Code)
    fp.close()
    fp = open("C:\\Temp\\util.py", "w")
    fp.write(Util)
    fp.close()
    #Kör pythonkoden och läs tillbaka svaret
    comm = subprocess.Popen([Python, "C:\\Temp\\readresult.py"], stdout=subprocess.PIPE)
    print(comm.stdout.read().decode('utf-8'))
    comm.stdout.close()
    comm.wait()
# ---------- end read_result ----------
panel_5 = Panel(read_result)

# ---- group: Create shades in two steps
pipeline = GeometryPipeline(
    GroupByLayer=False,
    GroupByType=False,
    IncludeHidden=True,
    IncludeLocked=True,
    LayerFilter="Shades",
    NameFilter="*",
    SublayerFiltering=True,
    TypeFilter=1073741848)
falsestart = Ladybug_FalseStartToggle(False)
falsestart_2 = Ladybug_FalseStartToggle(False)
cluster = Cluster(
    run_step_1=falsestart,
    dir=ida_modell_path,
    objects=pipeline,
    ice_path=ida_ice_path,
    model_path=ida_modell_path,
    model_name=ida_ice_modell_name,
    run=falsestart_2)

# ---- group: Create windows method 1
pipeline_2 = GeometryPipeline(
    GroupByLayer=False,
    GroupByType=False,
    IncludeHidden=True,
    IncludeLocked=True,
    LayerFilter="Windows",
    NameFilter="*",
    SublayerFiltering=True,
    TypeFilter=1073741848)
falsestart_3 = Ladybug_FalseStartToggle(False)
create_windows = CreateWindows(ice_path=ida_ice_path, model_path=ida_modell_path, model_name=ida_ice_modell_name, run=falsestart_3, windows=pipeline_2)

# ---- group: Create building body from planar horizontal surfaces
pipeline_3 = GeometryPipeline(
    GroupByLayer=False,
    GroupByType=False,
    IncludeHidden=True,
    IncludeLocked=True,
    LayerFilter="Floorplan",
    NameFilter="*",
    SublayerFiltering=True,
    TypeFilter=1073741848)
falsestart_4 = Ladybug_FalseStartToggle(False)
create_buildingbody = CreateBuildingbody(
    floorplans=pipeline_3,
    ice_path=ida_ice_path,
    model_path=ida_modell_path,
    model_name=ida_ice_modell_name,
    building_name="Building no ",
    height="3",
    run=falsestart_4)

# ---- group: Create zones
pipeline_4 = GeometryPipeline(
    GroupByLayer=False,
    GroupByType=False,
    IncludeHidden=True,
    IncludeLocked=True,
    LayerFilter="Zones",
    NameFilter="*",
    SublayerFiltering=True,
    TypeFilter=1073741848)
falsestart_5 = Ladybug_FalseStartToggle(False)
create_thermal_zones = CreateThermalZones(
    floorplans=pipeline_4,
    ice_path=ida_ice_path,
    model_path=ida_modell_path,
    model_name=ida_ice_modell_name,
    building_name="Room no ",
    height="2.8",
    run=falsestart_5)

# ----
geo_3 = Geometry([<mesh referenced from the Rhino model> x155])
quad = Quadrangulate(Mesh=geo_3, Angle=0.03490658504, Ratio=0.875)  # -> Mesh, Count
faceb = FaceBoundaries(Mesh=quad.Mesh)

# ---- group: Create windows by pyramids
pipeline_5 = GeometryPipeline(
    GroupByLayer=False,
    GroupByType=False,
    IncludeHidden=True,
    IncludeLocked=True,
    LayerFilter="Windows",
    NameFilter="*",
    SublayerFiltering=True,
    TypeFilter=1073741848)
falsestart_6 = Ladybug_FalseStartToggle(False)
cluster_2 = Cluster_3(ice_path=ida_ice_path, model_path=ida_modell_path, windows=pipeline_5, model_name=ida_ice_modell_name, run=falsestart_6)

# ----
# Tips:
# - Zone floors and building bodies can be built by using planar horizontal surfaces. They can be created by usiing Pline and "Surfaces from planar curves".
# - Zones, Windows, Building bodies and external shading objects should be in separate layers.
# - Make sure that the idm-file is located in a folder where you have write access.
# - Make sure that you create windows before you create zones, otherwise the zones will be deleted.
# - Zones and building bodies can have a fixed height or use a list.
# Limitations:
# - Prismtic zones
# - Prismatic building bodies
# - Rektangular windows
panel_6 = Panel("""Buggar:
- Probably""")

# ---- group: Create Windows IFC script
falsestart_7 = Ladybug_FalseStartToggle(False)
cluster_3 = Cluster_2(ice_path=ida_ice_path, model_path=ida_modell_path, windows=pipeline_5, model_name=ida_ice_modell_name, run=falsestart_7)

# ----
pipeline_6 = GeometryPipeline(
    GroupByLayer=False,
    GroupByType=False,
    IncludeHidden=True,
    IncludeLocked=True,
    LayerFilter="Windows",
    NameFilter="*",
    SublayerFiltering=True,
    TypeFilter=32)

# ---- group: Create Windows IFC script + CS
# To improve:
# - Zoner based upon height
# -Custom geometries
pipeline_7 = GeometryPipeline(
    GroupByLayer=False,
    GroupByType=False,
    IncludeHidden=True,
    IncludeLocked=True,
    LayerFilter="Windows",
    NameFilter="*",
    SublayerFiltering=True,
    TypeFilter=32)
cluster_4 = Cluster_4(ice_path=ida_ice_path, model_path=ida_modell_path, model_name=ida_ice_modell_name, run=Toggle(False), geo=pipeline_7)

# ==== cluster CreateWindows
windows = ClusterInput()
windows_2 = Geometry(windows)
boxrec = BoxRectangle(Rectangle=windows_2, Height="0.6")
boxrec_2 = BoxRectangle(Rectangle=windows_2, Height="-0.6")
vb = VBScript(boxes=[boxrec, boxrec_2])  # -> out, corners
# ---------- vb: VB ----------
    Dim pts(8) As point3d
    pts = boxes.GetCorners()
    corners = pts
# ---------- end vb ----------
# skapa ett hotisontellt plan i fönstrets nederkant som underlag för rummet. Detta har en offset på 6 dm.
pdecon = Deconstruct(Point=vb.corners)  # -> XComponent, YComponent, ZComponent
pt = ConstructPoint(XCoordinate=pdecon.ZComponent, YCoordinate=pdecon.XComponent, ZCoordinate=pdecon.XComponent)
sort_pt = SortPoints(Points=pt)  # -> Points, Indices
item = ListItem(List=vb.corners, Index=sort_pt.Indices, Wrap=True)
split = SplitList(List=item, Index="4")  # -> ListA, ListB
pt_2 = Point(split.ListA)
fcircle = CircleFit(Points=pt_2)  # -> Circle, Radius, Deviation
item_2 = ListItem(List=pt_2, Index=0, Wrap=True)
darc = DeconstructArc(Arc=fcircle.Circle)  # -> BasePlane, Radius, Angle
panel = Panel("Sortera medurs")
pdecon_2 = Deconstruct(Point=split.ListB)  # -> XComponent, YComponent, ZComponent
vec2pt = Vector2Pt(PointA=darc.BasePlane, PointB=item_2, Unitize=False)  # -> Vector, Length
vec2pt_2 = Vector2Pt(PointA=darc.BasePlane, PointB=pt_2, Unitize=False)  # -> Vector, Length
split_2 = SplitList(List=pdecon_2.ZComponent, Index="1")  # -> flatten(ListA), ListB
xy = XYPlane(Origin=Point(0, 0, 0))
angle = Angle(VectorA=vec2pt_2.Vector, VectorB=vec2pt.Vector, Plane=xy)  # -> Angle, Reflex
sort = SortList(Keys=angle.Angle, ValuesA=pt_2)  # -> Keys, ValuesA
pdecon_3 = Deconstruct(Point=sort.ValuesA)  # -> XComponent, YComponent, ZComponent
mgpolygon1 = VBScript(X=pdecon_3.XComponent, Y=pdecon_3.YComponent, Z=pdecon_3.ZComponent)  # -> Polygon
# ---------- mgpolygon1: VB usings ----------
Imports System.IO
Imports System.Linq
Imports System.Data
Imports System.Drawing
Imports System.Reflection
Imports System.Windows.Forms
Imports System.Xml
Imports System.Xml.Linq
Imports Microsoft.VisualBasic
Imports System.Runtime.InteropServices

Imports Rhino.DocObjects
Imports Rhino.Collections
Imports GH_IO
Imports GH_IO.Serialization
Imports System.Text.RegularExpressions
# ---------- mgpolygon1: VB ----------
    Polygon = CStr("(" + CStr(X) + " " + CStr(Y) + ") ")
# ---------- end mgpolygon1 ----------
split_3 = SplitList(List=pdecon_3.ZComponent, Index="1")  # -> flatten(ListA), ListB
join = TextJoin(Text=mgpolygon1)  # -> flatten(Result)
subtraction = Subtraction(A=split_2.ListA, B=split_3.ListA)
index = ItemIndex(List=join, Item=join)
create_thermal_zones = VBScript(Floorplans=join, Z=split_3.ListA, Index=index, Height=subtraction)  # -> Scriptout
# ---------- create_thermal_zones: VB ----------
    Dim Antal As Integer
    Antal = 4 ' Alltid rektangulära golv
    Scriptout = "  (:ADD (CE-ZONE :N """ + "Tempwindowzone No " + Cstr(Index) + """ :T ZONE)"
    Scriptout = Scriptout + vbCrLf + "   ((Aggregate :N GEOMETRY :X ZONE)"
    Scriptout = Scriptout + vbCrLf + "    (:PAR :N ORIGIN :V #(0.0 0.0) :S '(:DEFAULT NIL 2))"
    Scriptout = Scriptout + vbCrLf + "    (:PAR :N NCORN :V " + CStr(Antal) + " :S '(:DEFAULT NIL 2))"
    Scriptout = Scriptout + vbCrLf + "    (:PAR :N CEILING-HEIGHT :V " + CStr(Height) + ")"
    Scriptout = Scriptout + vbCrLf + "    (:PAR :N FLOOR_HEIGHT_FROM_GROUND :V " + CStr(Z) + ")"
    Scriptout = Scriptout + vbCrLf + "    (:PAR :N CORNERS :DIM (" + CStr(Antal) + " 2) :V #2A(" + CStr(Floorplans) + "))))" + vbCrLf
# ---------- end create_thermal_zones ----------
join_2 = TextJoin(Text=create_thermal_zones)
ice_path = ClusterInput()
model_path = ClusterInput()
model_name = ClusterInput()
run = ClusterInput()
create_thermal_zones_2 = VBScript(ICE_Path=ice_path, Model_Path=model_path, Model_Name=model_name, Scriptin=join_2, Run=run)  # -> A
# ---------- create_thermal_zones_2: VB ----------
    Dim Script As String
    Dim BatScript As String


    Model_Path = CStr(Model_Path) + "\"
    Script = Model_Path.Replace("\", "\\")
    Script = "(:SET doc_ (:call get-document """ + CStr(Script) + CStr(Model_Name) + """))"
    Script = Script + vbCrLf + "(:SHOW doc_)"
    Script = Script + vbCrLf + "(:UPDATE doc_"
    Script = Script + vbCrLf + CStr(Scriptin) + vbCrLf
    Script = Script + vbCrLf + ")"
    'Justera ett mellanrum i slutet av var zon
    Script = Script.Replace(" ))))", "))))")
    'Skapa fönster som täcker alla ytterväggar
    Script = Script + vbCrLf + "(:for (w [doc_ :ice-all-enclosing] :when (<= 60 [w geometry slope] 120) ) (add-band-feature w 1 0 window) )"
    'Flytta fönster från tempzoner till fasader
    Script = Script + vbCrLf + "(:call mapcar 'zone-windows-to-face [doc_ :zones])"
    'Ta bort alla tempzoner, denna borde kompletteras med zongrupp så man inte råkar ta bort andra zoner
    Script = Script + vbCrLf + "(:for (zone_ [doc_ :zones] :when (:call string-equal " + Chr(34) + Chr(34) + " [zone_ group])) (:call delete-component zone_))"

    BatScript = Chr(34) & CStr(ICE_Path) & Chr(34) + " -X " + Chr(34) + CStr(Model_Path) + "script_createwindows.txt" + Chr(34)

    If Run = True Then
      'Skapa Scriptfil
      Dim myfilepath As String = Model_Path
      Dim myappendingoption As Boolean = False 'True: append text to file, False: overwrite
      Dim ScriptFile As StreamWriter = New StreamWriter(myfilepath + "script_createwindows.txt", myappendingoption, System.Text.Encoding.Default)
      ScriptFile.Write(Script)
      ScriptFile.Close()

      'Skapa BAT-fil
      Dim BatFile As StreamWriter = New StreamWriter(myfilepath + "script_createwindows.bat", myappendingoption, System.Text.Encoding.Default)
      BatFile.Write(BatScript)
      BatFile.Close()

      'Kör Bat-fil
      Dim objProcess As System.Diagnostics.Process
      objProcess = New System.Diagnostics.Process()
      objProcess.StartInfo.FileName = Model_Path + "script_createwindows.bat" 'Kör bat-filen
      objProcess.Start()
      'Wait until the process passes back an exit code
      objProcess.WaitForExit()
      'Free resources associated with this process
      objProcess.Close()
      'Ta bort BAT-fil och skriptfil
      My.Computer.FileSystem.DeleteFile(myfilepath + "script_createwindows.bat")
      'Nedan borde städas också men jag vet inte när det är säkert att ta bort den.
      'My.Computer.FileSystem.DeleteFile(Model_Path + "script_createzones.txt")
    End If
# ---------- end create_thermal_zones_2 ----------

# ==== cluster CreateThermalZones
floorplans = ClusterInput()
explode = Explode(Floorplans=floorplans, Recursive=True)  # -> Segments, Vertices
merge = VBScript(x=explode.Vertices, y="1")  # -> A; inputs x: list
# ---------- merge: VB usings ----------
Imports System.IO
Imports System.Linq
Imports System.Data
Imports System.Drawing
Imports System.Reflection
Imports System.Windows.Forms
Imports System.Xml
Imports System.Xml.Linq
Imports Microsoft.VisualBasic
Imports System.Runtime.InteropServices

Imports Rhino.DocObjects
Imports Rhino.Collections
Imports GH_IO
Imports GH_IO.Serialization
# ---------- merge: VB ----------
    Dim myList As New List(Of Object)

    For i As Integer = 0 To x.Count - 1 - y
      myList.Add(x(i))
    Next

    A = myList
# ---------- end merge ----------
pdecon = Deconstruct(Point=merge)  # -> XComponent, YComponent, ZComponent
mgpolygon1 = VBScript(X=pdecon.XComponent, Y=pdecon.YComponent, Z=pdecon.ZComponent)  # -> Polygon; same code as mgpolygon1
item = ListItem(List=pdecon.ZComponent, Index=Slider(1, range=0..1), Wrap=True)  # -> flatten(Item)
lng = ListLength(List=pdecon.XComponent)  # -> flatten(Length)
join = TextJoin(Text=mgpolygon1)  # -> flatten(Result)
index = ItemIndex(List=join, Item=join)
building_name = ClusterInput()
height = ClusterInput()
create_thermal_zones = VBScript(Floorplans=join, Z=item, Building_Name=building_name, Index=index, Height=height, Antal=lng)  # -> Scriptout
# ---------- create_thermal_zones: VB ----------
    Dim i As Integer
    i = i + 1
    Scriptout = "  (:ADD (CE-ZONE :N """ + Cstr(Building_Name) + Cstr(Index) + """ :T ZONE)"
    Scriptout = Scriptout + vbCrLf + "   ((Aggregate :N GEOMETRY :X ZONE)"
    Scriptout = Scriptout + vbCrLf + "    (:PAR :N ORIGIN :V #(0.0 0.0) :S '(:DEFAULT NIL 2))"
    Scriptout = Scriptout + vbCrLf + "    (:PAR :N NCORN :V " + CStr(Antal) + " :S '(:DEFAULT NIL 2))"
    Scriptout = Scriptout + vbCrLf + "    (:PAR :N CEILING-HEIGHT :V " + CStr(Height) + ")"
    Scriptout = Scriptout + vbCrLf + "    (:PAR :N FLOOR_HEIGHT_FROM_GROUND :V " + CStr(Z) + ")"
    Scriptout = Scriptout + vbCrLf + "    (:PAR :N CORNERS :DIM (" + CStr(Antal) + " 2) :V #2A(" + CStr(Floorplans) + "))))" + vbCrLf
# ---------- end create_thermal_zones ----------
join_2 = TextJoin(Text=create_thermal_zones)
ice_path = ClusterInput()
model_path = ClusterInput()
model_name = ClusterInput()
run = ClusterInput()
create_thermal_zones_2 = VBScript(ICE_Path=ice_path, Model_Path=model_path, Model_Name=model_name, Scriptin=join_2, Run=run)  # -> A
# ---------- create_thermal_zones_2: VB ----------
    Dim Script As String
    Dim BatScript As String


    Model_Path = CStr(Model_Path) + "\"
    Script = Model_Path.Replace("\", "\\")
    Script = "(:SET doc_ (:call get-document """ + CStr(Script) + CStr(Model_Name) + """))"
    Script = Script + vbCrLf + "(:SHOW doc_)"
    Script = Script + vbCrLf + "(:UPDATE doc_"
    'Ta bort alla befintliga zoner, denna är till för om man vill uppdatera zonlistor.
    Script = Script + vbCrLf + "(:for (zone_ [doc_ :zones] :when (:call string-equal " + Chr(34) + Chr(34) + " [zone_ group])) (:call delete-component zone_))"
    Script = Script + vbCrLf + CStr(Scriptin) + vbCrLf
    Script = Script + vbCrLf + ")"
    'Justera ett mellanrum i slutet av var zon
    Script = Script.Replace(" ))))", "))))")
    BatScript = Chr(34) & CStr(ICE_Path) & Chr(34) + " -X " + Chr(34) + CStr(Model_Path) + "script_createzones.txt" + Chr(34)

    If Run = True Then
      'Skapa Scriptfil
      Dim myfilepath As String = Model_Path
      Dim myappendingoption As Boolean = False 'True: append text to file, False: overwrite
      Dim ScriptFile As StreamWriter = New StreamWriter(myfilepath + "script_createzones.txt", myappendingoption, System.Text.Encoding.Default)
      ScriptFile.Write(Script)
      ScriptFile.Close()

      'Skapa BAT-fil
      Dim BatFile As StreamWriter = New StreamWriter(myfilepath + "script_createzones.bat", myappendingoption, System.Text.Encoding.Default)
      BatFile.Write(BatScript)
      BatFile.Close()

      'Kör Bat-fil
      Dim objProcess As System.Diagnostics.Process
      objProcess = New System.Diagnostics.Process()
      objProcess.StartInfo.FileName = Model_Path + "script_createzones.bat" 'Kör bat-filen
      objProcess.Start()
      'Wait until the process passes back an exit code
      objProcess.WaitForExit()
      'Free resources associated with this process
      objProcess.Close()
      'Ta bort BAT-fil och skriptfil
      'My.Computer.FileSystem.DeleteFile(myfilepath + "script_createzones.bat")
      'Nedan borde städas också men jag vet inte när det är säkert att ta bort den.
      'My.Computer.FileSystem.DeleteFile(Model_Path + "script_createzones.txt")
    End If
# ---------- end create_thermal_zones_2 ----------

# ==== cluster CreateBuildingbody
floorplans = ClusterInput()
explode = Explode(Floorplans=floorplans, Recursive=True)  # -> Segments, Vertices
merge = VBScript(x=explode.Vertices, y="1")  # -> A; inputs x: list; same code as merge
pdecon = Deconstruct(Point=merge)  # -> XComponent, YComponent, ZComponent
mgpolygon1 = VBScript(X=pdecon.XComponent, Y=pdecon.YComponent, Z=pdecon.ZComponent)  # -> Polygon; same code as mgpolygon1
item = ListItem(List=pdecon.ZComponent, Index=Slider(1, range=0..1), Wrap=True)  # -> flatten(Item)
lng = ListLength(List=pdecon.XComponent)  # -> flatten(Length)
join = TextJoin(Text=mgpolygon1)  # -> flatten(Result)
index = ItemIndex(List=join, Item=join)
building_name = ClusterInput()
height = ClusterInput()
create_buildingbodies = VBScript(Floorplans=join, Z=item, Building_Name=building_name, Index=index, Height=height, Antal=lng)  # -> Scriptout
# ---------- create_buildingbodies: VB ----------
    Scriptout = "  (:ADD (CE-SECTION :N " + Chr(34) + CStr(Building_Name) + CStr(Index) + Chr(34) + " :T BUILDING-SECTION)"
    Scriptout = Scriptout + vbCrLf + "    (:PAR :N NCORN :V " + CStr(Antal) + " :S '(:DEFAULT NIL 2))"
    Scriptout = Scriptout + vbCrLf + "    (:PAR :N CORNERS :Dim (" + CStr(Antal) + " 2) :V #2A(" + CStr(Floorplans) + "))"
    Scriptout = Scriptout + vbCrLf + "    (:PAR :N HEIGHT :V " + CStr(Z + Height) + ")"
    Scriptout = Scriptout + vbCrLf + "    (:PAR :N BOTTOM :V " + CStr(Z) + "))" + vbCrLf
# ---------- end create_buildingbodies ----------
ice_path = ClusterInput()
model_path = ClusterInput()
model_name = ClusterInput()
join_2 = TextJoin(Text=create_buildingbodies)
run = ClusterInput()
create_thermal_zones = VBScript(ICE_Path=ice_path, Model_Path=model_path, Model_Name=model_name, Scriptin=join_2, Run=run)  # -> A
# ---------- create_thermal_zones: VB ----------
    Dim Script As String
    Dim BatScript As String

    Model_Path = CStr(Model_Path) + "\"
    Script = Model_Path.Replace("\", "\\")
    Script = "(:SET doc_ (:call get-document """ + CStr(Script) + CStr(Model_Name) + """))"
    Script = Script + vbCrLf + "(:SHOW doc_)"
    Script = Script + vbCrLf + "(:UPDATE doc_"
    Script = Script + vbCrLf + CStr(Scriptin)
    'Nedan verkar behövas för den automatgenererade byggnadskroppen
    Script = Script + vbCrLf + "(:REMOVE " + Chr(34) + "Building body" + Chr(34) + ")" + vbCrLf
    Script = Script + vbCrLf + ")"
    'Justera ett mellanrum i slutet av var byggnad
    Script = Script.Replace(" ))))", "))))")

    BatScript = Chr(34) & CStr(ICE_Path) & Chr(34) + " -X " + Chr(34) + CStr(Model_Path) + "script_createbuildingbodies.txt" + Chr(34)

    If Run = True Then
      'Skapa Scriptfil
      Dim myfilepath As String = Model_Path
      Dim myappendingoption As Boolean = False 'True: append text to file, False: overwrite
      Dim ScriptFile As StreamWriter = New StreamWriter(myfilepath + "script_createbuildingbodies.txt", myappendingoption, System.Text.Encoding.Default)
      ScriptFile.Write(Script)
      ScriptFile.Close()

      'Skapa BAT-fil
      Dim BatFile As StreamWriter = New StreamWriter(myfilepath + "script_createbuildingbodies.bat", myappendingoption, System.Text.Encoding.Default)
      BatFile.Write(BatScript)
      BatFile.Close()

      'Kör Bat-fil
      Dim objProcess As System.Diagnostics.Process
      objProcess = New System.Diagnostics.Process()
      objProcess.StartInfo.FileName = Model_Path + "script_createbuildingbodies.bat" 'Kör bat-filen
      objProcess.Start()
      'Wait until the process passes back an exit code
      objProcess.WaitForExit()
      'Free resources associated with this process
      objProcess.Close()
      'Ta bort BAT-fil och skriptfil
      'My.Computer.FileSystem.DeleteFile(myfilepath + "script_createbuildingbodies.bat")
      'Nedan borde städas också men jag vet inte när det är säkert att ta bort den.
      'My.Computer.FileSystem.DeleteFile(Model_Path + "script_createbuildingbodies.txt")
    End If
# ---------- end create_thermal_zones ----------

# ==== cluster Cluster
panel = Panel("""  (:ADD (AGGREGATE :N ARCDATA)
   ((AGGREGATE :N "shadeobj2" :T PICT3D)
    (:PAR :N FILE :V "path")
   )
  )
)""")
run_step_1 = ClusterInput()
ice_path = ClusterInput()
model_path = ClusterInput()
model_name = ClusterInput()
run = ClusterInput()
dir = ClusterInput()
objects = ClusterInput()
save = ObjectSave(
    BakeToggle=run_step_1,
    FileDirectory=dir,
    FileName="shadeobj.obj",
    GeometryObjects=objects,
    Layer="GH_Export",
    ObjectName="GH_Obj",
    ObjectColor=RGB(255, 255, 255),
    LayerColor=RGB(255, 255, 255))
create_thermal_zones = VBScript(ICE_Path=ice_path, Model_Path=model_path, Model_Name=model_name, Scriptin=panel, File="shadeobj.obj", Run=run)  # -> A
# ---------- create_thermal_zones: VB ----------
    Dim Script As String
    Dim BatScript As String
    Dim Model_Path2 As String
    Dim Model_Path3 As String

    Model_Path = CStr(Model_Path) + "\"
    Model_Path2 = Model_Path.Replace("\", "\\")
    Script = Model_Path2
    Script = "(:SET doc_ (:call get-document """ + CStr(Script) + CStr(Model_Name) + """))"
    Script = Script + vbCrLf + "(:SHOW doc_)"
    Script = Script + vbCrLf + "(:UPDATE doc_"
    Script = Script + vbCrLf + CStr(Scriptin) + vbCrLf
    'Justera ett mellanrum i slutet av var zon
    Model_Path3 = Model_Path2 + File
    Script = Script.Replace("path", CStr(Model_Path3))

    BatScript = Chr(34) & CStr(ICE_Path) & Chr(34) + " -X " + Chr(34) + CStr(Model_Path) + "script_createshades.txt" + Chr(34)

    If Run = True Then
      'Skapa Scriptfil
      Dim myfilepath As String = Model_Path
      Dim myappendingoption As Boolean = False 'True: append text to file, False: overwrite
      Dim ScriptFile As StreamWriter = New StreamWriter(myfilepath + "script_createshades.txt", myappendingoption, System.Text.Encoding.Default)
      ScriptFile.Write(Script)
      ScriptFile.Close()

      'Skapa BAT-fil
      Dim BatFile As StreamWriter = New StreamWriter(myfilepath + "script_createshades.bat", myappendingoption, System.Text.Encoding.Default)
      BatFile.Write(BatScript)
      BatFile.Close()

      'Kör Bat-fil
      Dim objProcess As System.Diagnostics.Process
      objProcess = New System.Diagnostics.Process()
      objProcess.StartInfo.FileName = Model_Path + "script_createshades.bat" 'Kör bat-filen
      objProcess.Start()
      'Wait until the process passes back an exit code
      objProcess.WaitForExit()
      'Free resources associated with this process
      objProcess.Close()
      'Ta bort BAT-fil och skriptfil
      'My.Computer.FileSystem.DeleteFile(myfilepath + "script_createzones.bat")
      'Nedan borde städas också men jag vet inte när det är säkert att ta bort den.
      'My.Computer.FileSystem.DeleteFile(Model_Path + "script_createzones.txt")
    End If
# ---------- end create_thermal_zones ----------

# ==== cluster Cluster_2
windows = ClusterInput()
windows_2 = Geometry(windows)
id = Guid(windows_2)
demesh = DeconstructMesh(Mesh=windows_2)  # -> Vertices, Faces, Colours, Normals
pdecon = Deconstruct(Point=demesh.Normals)  # -> XComponent, YComponent, ZComponent
pdecon_2 = Deconstruct(Point=demesh.Vertices)  # -> expr("round(x,2)", XComponent), expr("round(x,2)", YComponent), expr("round(x,2)", ZComponent)
mgpolygon1 = VBScript(X=pdecon.XComponent, Y=pdecon.YComponent, Z=pdecon.ZComponent)  # -> Polygon
# ---------- mgpolygon1: VB usings ----------
Imports System.IO
Imports System.Linq
Imports System.Data
Imports System.Drawing
Imports System.Reflection
Imports System.Windows.Forms
Imports System.Xml
Imports System.Xml.Linq
Imports Microsoft.VisualBasic
Imports System.Runtime.InteropServices

Imports Rhino.DocObjects
Imports Rhino.Collections
Imports GH_IO
Imports GH_IO.Serialization
Imports System.Text.RegularExpressions
# ---------- mgpolygon1: VB ----------
    Polygon = CStr("(" + CStr(X) + " " + CStr(Y) + " " + CStr(Z) + ") ")
# ---------- end mgpolygon1 ----------
mgpolygon1_2 = VBScript(X=pdecon_2.XComponent, Y=pdecon_2.YComponent, Z=pdecon_2.ZComponent)  # -> Polygon; same code as mgpolygon1
rep = ReplaceText(Text="(AGGREGATE :T IFCIM_WINDOW :N \"Windowname\") ", Find="Windowname", Replace=id, RecursiveReplace=False)
item = ListItem(List=mgpolygon1_2, Index="4", Wrap=True)  # -> flatten(Item)
item_2 = ListItem(List=mgpolygon1, Index="4", Wrap=True)  # -> flatten(Item)
create_thermal_zones = VBScript(P1=item, P2=item_2, P3=rep, P4="(:PAR :N DY :V 1) ", P5="(:PAR :N DX :V 1) ", P6="(:PAR :N STYLE :V \"Windowbesk\"))")  # -> flatten(Scriptout)
# ---------- create_thermal_zones: VB ----------
    Scriptout = "(" + CStr(P1)
    Scriptout = Scriptout + "" + CStr(P2)
    Scriptout = Scriptout + "" + CStr(P3)
    Scriptout = Scriptout + "" + CStr(P4)
    Scriptout = Scriptout + "" + CStr(P5)
    Scriptout = Scriptout + "" + CStr(P6)
# ---------- end create_thermal_zones ----------
join = TextJoin(Text=create_thermal_zones)
ice_path = ClusterInput()
model_path = ClusterInput()
model_name = ClusterInput()
run = ClusterInput()
create_thermal_zones_2 = VBScript(ICE_Path=ice_path, Model_Path=model_path, Model_Name=model_name, Scriptin1=join, Run=run)  # -> A
# ---------- create_thermal_zones_2: VB ----------
    If Run = True Then
      'Skapa Scriptfil
      Dim myfilepath As String = Model_Path
      Dim myappendingoption As Boolean = False 'True: append text to file, False: overwrite
      Dim tempscript As String = Scriptin1
      Dim ScriptFile As StreamWriter = New StreamWriter(myfilepath + "\createwindowscript.txt", myappendingoption, System.Text.Encoding.Default)
      ScriptFile.Write(tempscript)
      ScriptFile.Close()

      'Skapa BAT-fil
      'Dim BatFile As StreamWriter = New StreamWriter(myfilepath + "script_createwindows.bat", myappendingoption, System.Text.Encoding.Default)
      'BatFile.Write(BatScript)
      'BatFile.Close()

      'Kör Bat-fil
      'Dim objProcess As System.Diagnostics.Process
      'objProcess = New System.Diagnostics.Process()
      'objProcess.StartInfo.FileName = Model_Path + "script_createwindows.bat" 'Kör bat-filen
      'objProcess.Start()
      'Wait until the process passes back an exit code
      'objProcess.WaitForExit()
      'Free resources associated with this process
      'objProcess.Close()
      'Ta bort BAT-fil och skriptfil
      'My.Computer.FileSystem.DeleteFile(myfilepath + "script_createwindows.bat")
      'Nedan borde städas också men jag vet inte när det är säkert att ta bort den.
      'My.Computer.FileSystem.DeleteFile(Model_Path + "script_createzones.txt")
    End If
# ---------- end create_thermal_zones_2 ----------

# ==== cluster Cluster_3
windows = ClusterInput()
windows_2 = Geometry(windows)
flipm = FlipMesh(Mesh=windows_2, VertexNormals=True, FaceNormals=True, FaceOrientation=True)
demesh = DeconstructMesh(Mesh=windows_2)  # -> Vertices, Faces, Colours, Normals
facen = FaceNormals(Mesh=windows_2)  # -> Centers, Normals
item = ListItem(List=facen.Normals, Index="1", Wrap=True)  # -> flatten(Item)
# Slumpmässigt namn baserat på ID
id = Guid(windows_2)
facen_2 = FaceNormals(Mesh=flipm)  # -> Centers, Normals
item_2 = ListItem(List=facen_2.Normals, Index="1", Wrap=True)  # -> flatten(Item)
multiplication = Multiplication(A=item, B="0.5")
item_3 = ListItem(List=facen.Centers, Index="1", Wrap=True)  # -> flatten(Item)
multiplication_2 = Multiplication(A=item_2, B="0.5")
item_4 = ListItem(List=facen_2.Centers, Index="1", Wrap=True)  # -> flatten(Item)
move = Move(Geometry=item_3, Motion=multiplication)  # -> Geometry, Transform
move_2 = Move(Geometry=item_4, Motion=multiplication_2)  # -> Geometry, Transform
pdecon = Deconstruct(Point=demesh.Vertices)  # -> XComponent, YComponent, ZComponent
pdecon_2 = Deconstruct(Point=demesh.Vertices)  # -> XComponent, YComponent, ZComponent
pdecon_3 = Deconstruct(Point=demesh.Vertices)  # -> XComponent, YComponent, ZComponent
pdecon_4 = Deconstruct(Point=demesh.Vertices)  # -> XComponent, YComponent, ZComponent
pdecon_5 = Deconstruct(Point=move.Geometry)  # -> XComponent, YComponent, ZComponent
pdecon_6 = Deconstruct(Point=move_2.Geometry)  # -> XComponent, YComponent, ZComponent
mgpolygon1 = VBScript(X=pdecon.XComponent, Y=pdecon.YComponent, Z=pdecon.ZComponent)  # -> Polygon; same code as mgpolygon1
mgpolygon1_2 = VBScript(X=pdecon_2.XComponent, Y=pdecon_2.YComponent, Z=pdecon_2.ZComponent)  # -> Polygon; same code as mgpolygon1
mgpolygon1_3 = VBScript(X=pdecon_3.XComponent, Y=pdecon_3.YComponent, Z=pdecon_3.ZComponent)  # -> Polygon; same code as mgpolygon1
mgpolygon1_4 = VBScript(X=pdecon_4.XComponent, Y=pdecon_4.YComponent, Z=pdecon_4.ZComponent)  # -> Polygon; same code as mgpolygon1
mgpolygon1_5 = VBScript(X=pdecon_5.XComponent, Y=pdecon_5.YComponent, Z=pdecon_5.ZComponent)  # -> flatten(Polygon); same code as mgpolygon1
mgpolygon1_6 = VBScript(X=pdecon_6.XComponent, Y=pdecon_6.YComponent, Z=pdecon_6.ZComponent)  # -> flatten(Polygon); same code as mgpolygon1
item_5 = ListItem(List=mgpolygon1_2, Index="1", Wrap=True)  # -> flatten(Item)
item_6 = ListItem(List=mgpolygon1, Index="2", Wrap=True)  # -> flatten(Item)
item_7 = ListItem(List=mgpolygon1_3, Index="3", Wrap=True)  # -> flatten(Item)
item_8 = ListItem(List=mgpolygon1_4, Index="4", Wrap=True)  # -> flatten(Item)
rep = ReplaceText(Text=id, Find="-", Replace="--", RecursiveReplace=False)
# Ordningen på kopplingarna är viktig!!
create_thermal_zones = VBScript(P1=item_8, P2=item_6, P3=item_7, P4=item_5, P5=mgpolygon1_5, Index=id)  # -> flatten(Scriptout)
# ---------- create_thermal_zones: VB ----------
    'Scriptout = "  (:ADD (CE-ZONE :T ZONE)"
    Scriptout = "  (:ADD (CE-ZONE :N """ + "Tempwindowzone No " + Cstr(Index) + """ :T ZONE)"
    Scriptout = Scriptout + vbCrLf + "   ((AGGREGATE :N GEOMETRY :X NIL)"
    Scriptout = Scriptout + vbCrLf + "    (:PAR :N PROTECTED_SHAPE :V :TRUE)"
    Scriptout = Scriptout + vbCrLf + "    (:PAR :N SHAPE)"
    Scriptout = Scriptout + vbCrLf + "    (:PAR :N NCORN :V 3)"
    Scriptout = Scriptout + vbCrLf + "    (:PAR :N CONTOURS :V (3)))"
    Scriptout = Scriptout + vbCrLf + "   ((ENCLOSING-ELEMENT :N """ + "FLOOR1" + """ :T FLOOR :INDEX -2000)"
    Scriptout = Scriptout + vbCrLf + "    ((AGGREGATE :N GEOMETRY)"
    Scriptout = Scriptout + vbCrLf + "     (:PAR :N CORNERS :DIM (3 3) :SP (3 3) :V #2A(" + CStr(P1) + " " + CStr(P5) + " " + CStr(P4) + "))))"
    Scriptout = Scriptout + vbCrLf + "   ((ENCLOSING-ELEMENT :N """ + "WALL1" + """ :T WALL :INDEX 1)"
    Scriptout = Scriptout + vbCrLf + "    ((AGGREGATE :N GEOMETRY)"
    Scriptout = Scriptout + vbCrLf + "     (:PAR :N CORNERS :DIM (3 3) :SP (3 3) :V #2A(" + CStr(P2) + " " + CStr(P5) + " " + CStr(P1) + "))))"
    Scriptout = Scriptout + vbCrLf + "   ((ENCLOSING-ELEMENT :N """ + "WALL2" + """ :T WALL :INDEX 2)"
    Scriptout = Scriptout + vbCrLf + "    ((AGGREGATE :N GEOMETRY)"
    Scriptout = Scriptout + vbCrLf + "     (:PAR :N CORNERS :V #2A(" + CStr(P4) + " " + CStr(P3) + " " + CStr(P2) + " " + CStr(P1) + "))))"
    Scriptout = Scriptout + vbCrLf + "   ((ENCLOSING-ELEMENT :N """ + "WALL3" + """ :T WALL :INDEX 3)"
    Scriptout = Scriptout + vbCrLf + "    ((AGGREGATE :N GEOMETRY)"
    Scriptout = Scriptout + vbCrLf + "     (:PAR :N CORNERS :DIM (3 3) :SP (3 3) :V #2A(" + CStr(P4) + " " + CStr(P5) + " " + CStr(P3) + "))))"
    Scriptout = Scriptout + vbCrLf + "   ((ENCLOSING-ELEMENT :N """ + "CEILING1" + """ :T CEILING :INDEX -1000)"
    Scriptout = Scriptout + vbCrLf + "    ((AGGREGATE :N GEOMETRY)"
    Scriptout = Scriptout + vbCrLf + "     (:PAR :N CORNERS :DIM (3 3) :SP (3 3) :V #2A(" + CStr(P2) + " " + CStr(P3) + " " + CStr(P5) + ")))))" + vbCrLf
# ---------- end create_thermal_zones ----------
create_thermal_zones_2 = VBScript(P1=item_5, P2=item_7, P3=item_6, P4=item_8, P5=mgpolygon1_6, Index=rep)  # -> flatten(Scriptout); same code as create_thermal_zones
join = TextJoin(Text=create_thermal_zones_2)
join_2 = TextJoin(Text=create_thermal_zones)
ice_path = ClusterInput()
model_path = ClusterInput()
model_name = ClusterInput()
run = ClusterInput()
create_thermal_zones_3 = VBScript(ICE_Path=ice_path, Model_Path=model_path, Model_Name=model_name, Scriptin1=join_2, Scriptin2=join, Run=run)  # -> A
# ---------- create_thermal_zones_3: VB ----------
    Dim Script As String
    Dim BatScript As String


    Model_Path = CStr(Model_Path) + "\"
    Script = Model_Path.Replace("\", "\\")
    Script = "(:SET doc_ (:call get-document """ + CStr(Script) + CStr(Model_Name) + """))"
    Script = Script + vbCrLf + "(:SHOW doc_)"
    Script = Script + vbCrLf + "(:UPDATE doc_"
    Script = Script + vbCrLf + CStr(Scriptin1) + vbCrLf
    'Skapa fönster som täcker alla ytterväggar och tak, justera vinklarna så de alltid fungerar!!!!!
    Script = Script + vbCrLf + "(:for (w [doc_ :ice-all-enclosing] :when (<= 60 [w geometry slope] 120) ) (add-band-feature w 1 0 window) )"
    'Flytta fönster från tempzoner till fasader
    Script = Script + vbCrLf + "(:call mapcar 'zone-windows-to-face [doc_ :zones])"
    'Ta bort alla tempzoner, denna borde kompletteras med zongrupp så man inte råkar ta bort andra zoner
    Script = Script + vbCrLf + "(:for (zone_ [doc_ :zones] :when (:call string-equal " + Chr(34) + Chr(34) + " [zone_ group])) (:call delete-component zone_))"
    'Lägg in de inverterade fönstren
    Script = Script + vbCrLf + CStr(Scriptin2) + vbCrLf
    Script = Script + vbCrLf + ")"
    'Justera ett mellanrum i slutet av var zon, dubbla mellanslag och mellanrum mellan paranteser
    Script = Script.Replace(" ))))", "))))")
    Script = Script.Replace("  ", " ")
    Script = Script.Replace(")  )", "))")
    'Skapa fönster som täcker alla ytterväggar och tak, justera vinklarna så de alltid fungerar!!!!!
    Script = Script + vbCrLf + "(:for (w [doc_ :ice-all-enclosing] :when (<= 60 [w geometry slope] 120) ) (add-band-feature w 1 0 window) )"
    'Flytta fönster från tempzoner till fasader
    Script = Script + vbCrLf + "(:call mapcar 'zone-windows-to-face [doc_ :zones])"
    'Ta bort alla tempzoner, denna borde kompletteras med zongrupp så man inte råkar ta bort andra zoner
    Script = Script + vbCrLf + "(:for (zone_ [doc_ :zones] :when (:call string-equal " + Chr(34) + Chr(34) + " [zone_ group])) (:call delete-component zone_))"

    BatScript = Chr(34) & CStr(ICE_Path) & Chr(34) + " -X " + Chr(34) + CStr(Model_Path) + "script_createwindows.txt" + Chr(34)

    If Run = True Then
      'Skapa Scriptfil
      Dim myfilepath As String = Model_Path
      Dim myappendingoption As Boolean = False 'True: append text to file, False: overwrite
      Dim ScriptFile As StreamWriter = New StreamWriter(myfilepath + "script_createwindows.txt", myappendingoption, System.Text.Encoding.Default)
      ScriptFile.Write(Script)
      ScriptFile.Close()

      'Skapa BAT-fil
      Dim BatFile As StreamWriter = New StreamWriter(myfilepath + "script_createwindows.bat", myappendingoption, System.Text.Encoding.Default)
      BatFile.Write(BatScript)
      BatFile.Close()

      'Kör Bat-fil
      Dim objProcess As System.Diagnostics.Process
      objProcess = New System.Diagnostics.Process()
      objProcess.StartInfo.FileName = Model_Path + "script_createwindows.bat" 'Kör bat-filen
      objProcess.Start()
      'Wait until the process passes back an exit code
      objProcess.WaitForExit()
      'Free resources associated with this process
      objProcess.Close()
      'Ta bort BAT-fil och skriptfil
      My.Computer.FileSystem.DeleteFile(myfilepath + "script_createwindows.bat")
      'Nedan borde städas också men jag vet inte när det är säkert att ta bort den.
      'My.Computer.FileSystem.DeleteFile(Model_Path + "script_createzones.txt")
    End If
# ---------- end create_thermal_zones_3 ----------

# ==== cluster Cluster_4
geo = ClusterInput()
geo_2 = Geometry(geo)
mesh = Mesh(geo_2)
facen = FaceNormals(Mesh=geo_2)  # -> Centers, Normals
area = Area(Geometry=geo_2)  # -> Area, Centroid
split = SplitList(List=facen.Normals, Index=Slider(1, range=0..1))  # -> ListA, ListB
facen_2 = FaceNormals(Mesh=mesh)  # -> Centers, Normals
id = Guid(geo_2)
item = ListItem(List=facen_2.Normals, Index=0, Wrap=True)  # -> simplify(Item)
xy = XYPlane(Origin=Point(0, 0, 0))
padjust = AdjustPlane(Plane=xy, Normal=item)
orient = Orient(Geometry=mesh, Source=flatten(padjust), Target=xy)  # -> Geometry, Transform
geo_3 = Geometry(orient.Geometry)
area_2 = MeshArea(Mesh=geo_3)  # -> Area, Centroid
subtraction = Subtraction(A="{0,0,0}", B=area_2.Centroid)
pdecon = Deconstruct(Point=split.ListA)  # -> XComponent, YComponent, ZComponent
pdecon_2 = Deconstruct(Point=area.Centroid)  # -> expr("round(x,2)", XComponent), expr("round(x,2)", YComponent), expr("round(x,2)", ZComponent)
rep = ReplaceText(Text="(AGGREGATE :T IFCIM_WINDOW :N \"Windowname\") ", Find="Windowname", Replace=id, RecursiveReplace=False)
move = Move(Geometry=geo_3, Motion=subtraction)  # -> Geometry, Transform
panel = Panel("Normalriktning")
mgpolygon1 = VBScript(X=pdecon.XComponent, Y=pdecon.YComponent, Z=pdecon.ZComponent)  # -> Polygon; same code as mgpolygon1
mgpolygon1_2 = VBScript(X=pdecon_2.XComponent, Y=pdecon_2.YComponent, Z=pdecon_2.ZComponent)  # -> Polygon; same code as mgpolygon1
bbox = BoundingBox(Content=move.Geometry, Plane=PlaneXY(0, 0, 0))  # -> Box, Box_2
debrep = DeconstructBrep(Brep=bbox.Box)  # -> Faces, Edges, Vertices
item_2 = ListItem(List=mgpolygon1, Index="4", Wrap=True)  # -> flatten(Item)
area_3 = Area(Geometry=debrep.Faces)  # -> Area, Centroid
sort = SortList(Keys=area_3.Area, ValuesA=debrep.Faces)  # -> reverse(Keys), reverse(ValuesA)
bbox_2 = BoundingBox(Content=mesh, Plane=PlaneXY(0, 0, 0))  # -> Box, Box_2
item_3 = ListItem(List=sort.ValuesA, Index=0, Wrap=True)
debrep_2 = DeconstructBrep(Brep=bbox_2.Box)  # -> Faces, Edges, Vertices
debrep_3 = DeconstructBrep(Brep=item_3)  # -> Faces, Edges, Vertices
midpt = CurveMiddle(Curve=debrep_2.Edges)
len = Length(Curve=debrep_3.Edges)
pdecon_3 = Deconstruct(Point=midpt)  # -> XComponent, YComponent, ZComponent
sort_2 = SortList(Keys=len)  # -> Keys, ValuesA
sort_3 = SortList(Keys=len)  # -> reverse(Keys), ValuesA
sort_4 = SortList(Keys=pdecon_3.ZComponent, ValuesA=debrep_2.Edges)  # -> Keys, ValuesA
item_4 = ListItem(List=sort_2.Keys, Index=0, Wrap=True)
item_5 = ListItem(List=sort_3.Keys, Index=0, Wrap=True)
item_6 = ListItem(List=sort_4.ValuesA, Index=0, Wrap=True)
ice_path = ClusterInput()
model_path = ClusterInput()
model_name = ClusterInput()
run = ClusterInput()
len_2 = Length(Curve=item_6)  # -> simplify(Length)
merge = Merge(Data1=item_4, Data2=item_5)  # -> simplify(Result)
# Equal med tolerans
# Pufferfish
equalst = EqualityWithinTolerance(FirstNumber=merge, SecondNumber=len_2, Tolerance=0.01)
num = Number(equalst)
subtraction_2 = Subtraction(A=num, B="1")
abs = Absolute(Value=subtraction_2)
num_2 = Number(equalst)
ma = MassAddition(Input=num_2)  # -> Result, PartialResults
subtraction_3 = Subtraction(A=ma.Result, B="1")
cull = CullPattern(List=merge, CullPattern=abs)
cull_2 = CullPattern(List=len_2, CullPattern=subtraction_3)
merge_2 = Merge(Data1=len_2, Data2=cull, Data3=cull_2)
item_7 = ListItem(List=merge_2, Index="0", Wrap=True)  # -> flatten(Item)
rep_2 = ReplaceText(Text="(:PAR :N DX :V 1) ", Find="1", Replace=item_7, RecursiveReplace=False)
item_8 = ListItem(List=merge_2, Index="1", Wrap=True)  # -> flatten(Item)
rep_3 = ReplaceText(Text="(:PAR :N DY :V 1) ", Find="1", Replace=item_8, RecursiveReplace=False)
create_thermal_zones = VBScript(P1=mgpolygon1_2, P2=item_2, P3=rep, P4=rep_3, P5=rep_2, P6="(:PAR :N STYLE :V \"Windowbesk\"))")  # -> flatten(Scriptout); same code as create_thermal_zones
join = TextJoin(Text=create_thermal_zones)
panel_2 = Panel(join)
create_thermal_zones_2 = VBScript(ICE_Path=ice_path, Model_Path=model_path, Model_Name=model_name, Scriptin1=join, Run=run)  # -> A; same code as create_thermal_zones_2
höjd = Panel(item_8)
bredd = Panel(item_7)

# ----
# PREVIEW
area_4 = MeshArea(Mesh=geo_2)  # -> Area, Centroid
pdecon_4 = Deconstruct(Point=area_4.Centroid)  # -> XComponent, YComponent, ZComponent
addition = Addition(A=pdecon_4.ZComponent, B=Slider(0.32, range=0..1))
pt = ConstructPoint(XCoordinate=pdecon_4.XComponent, YCoordinate=pdecon_4.YComponent, ZCoordinate=addition)
# Round med decimalplats
# Pufferfish
swatch = ColourSwatch(SwatchColor=RGB(0, 0, 0))
roundd = RoundToDecimalPlace(NumberX=item_7, DecimalPlace=Slider(2, range=0..10), RoundType=0)  # -> Rounded, Difference
roundd_2 = RoundToDecimalPlace(NumberX=item_8, DecimalPlace=Slider(2, range=0..10), RoundType=0)  # -> Rounded, Difference
concat = Concatenate(FragmentA="Bredd: ", FragmentB=roundd.Rounded)
concat_2 = Concatenate(FragmentA="Höjd: ", FragmentB=roundd_2.Rounded)
tag = TextTag3D(
    Location=area_4.Centroid,
    Text=concat,
    Size=Slider(0.14, range=0..1),
    Colour=ColourSwatch(SwatchColor=RGB(0, 0, 0)),
    Justification=Slider(2, range=0..10))
tag_2 = TextTag3D(Location=pt, Text=concat_2, Size=Slider(0.14, range=0..1), Colour=swatch, Justification=Slider(2, range=0..10))
